# Grasshopper definition project1.gh (Grasshopper 1.0.7)
# plug-ins: Pufferfish, ShapeDiverForGrasshopper

sddp = ShapeDiverDocumentPayload({AbsoluteTolerance=0, AngleTolerance=0, DistanceDisplayPrecision=0, GltfVersion="Gltf2", GrasshopperVersion="1.0.0007", InputGroups="{}", OutputGroups="{}", RelativeTolerance=0, RhinoVersion="7.33.23248.13002", UnitSystem=0, VersionCreated="1.15.0.0", VersionSaved="1.15.0.0"})
xy = XYPlane(Origin=Point(0, 0, 0))
panel = Panel("Adjust bowl dimensions")
bowl_height = Slider(67.7, range=38..90)
bowl_radius = Slider(85, range=70..135)
Z = UnitZ(Factor=bowl_height)
cir = Circle(Plane=xy, Radius=bowl_radius)
# Maintain bowl thickness of 6.35mm for all sizes
subtraction = Subtraction(A=bowl_radius, B=6.35)
# Create bowl using solid difference
move = Move(Geometry=cir, Motion=Z)  # -> Geometry, Transform
Z_2 = UnitZ(Factor=6.35)
cyl = Cylinder(Base=Z_2, Radius=subtraction, Length=95)
merge = Merge(Data1=cir, Data2=move.Geometry)
cap = CapHoles(Brep=cyl)
loft = Loft(Curves=merge, Options={Adjust=False, Closed=False, LoftEnds=0, LoftSimp=0, LoftType=0, Rebuild=10, Refit=0.01})
# Retrieve base circle from cylinder
debrep = DeconstructBrep(Brep=cap)  # -> Faces, Edges, Vertices
cap_2 = CapHoles(Brep=loft)
# Adjust intensity of slow feeder
groove_intensity = Slider(8, range=3..12)
groove_angle = Slider(13, range=0..30)
item = ListItem(List=debrep.Faces, Index=1, Wrap=True)
multiplication = Multiplication(A=bowl_height, B=0.666)
crv = Curve(item)
sdiff = SolidDifference(BrepsA=cap_2, BrepsB=cyl)
divide = DivideCurve(Curve=crv, Count=groove_intensity, Kinks=False)  # -> Points, Tangents, Parameters
area = Area(Geometry=crv)  # -> Area, Centroid
Z_3 = UnitZ(Factor=multiplication)
ln = Line(StartPoint=area.Centroid, EndPoint=divide.Points)
move_2 = Move(Geometry=ln, Motion=Z_3)  # -> Geometry, Transform
rad = Radians(Degrees=groove_angle)
rotate = Rotate(Geometry=move_2.Geometry, Angle=rad, Plane=PlaneXY(0, 0, 0))  # -> Geometry, Transform
crv_2 = Curve(ln)
crv_3 = Curve(rotate.Geometry)
merge_2 = Merge(Data1=graft(crv_3), Data2=graft(crv_2))
panel_2 = Panel("Make grooves solid")
loft_2 = Loft(Curves=merge_2, Options={Adjust=False, Closed=False, LoftEnds=0, LoftSimp=0, LoftType=0, Rebuild=10, Refit=0.01})
bool = Boolean(True)
offsrf = OffsetSurface(Surface=loft_2, Distance=5, BothSides=0, CreateSolid=bool)
panel_3 = Panel("make one solid")
sunion = SolidUnion(Breps=flatten([offsrf, sdiff]))
